% Simulink data dictionary AOTDataDictionary.sldd

Acceleration_ISO = Simulink.Bus()
  xddot: double
  yddot: double
  zddot: double

AngVel_ISO = Simulink.Bus()
  p: double
  q: double
  r: double

Orientation_ISO = Simulink.Bus()
  phi: double
  theta: double
  psi: double

Position_ISO = Simulink.Bus()
  X: double
  Y: double
  Z: double

Velocity_ISO = Simulink.Bus()
  Xdot: double
  Ydot: double
  Zdot: double

Veh_Fdbk = Simulink.Bus()
  Position_ISO: Position_ISO
  Velocity_ISO: Velocity_ISO
  Acceleration_ISO: Acceleration_ISO
  Orientation_ISO: Orientation_ISO
  AngVel_ISO: AngVel_ISO

L = 3.705
amax = 5
amin = -10
delta_max = 0.6981317
delta_min = -0.6981317
dt = 0.05
l_F = 1.2525
tf = 1
v_des = 15

BusActors = Simulink.Bus()
  NumActors: double
  Time: double
  Actors: Bus: BusActorsActors[2 1]

BusActorsActors = Simulink.Bus()
  ActorID: double
  Position: double[1 3]
  Velocity: double[1 3]
  Roll: double
  Pitch: double
  Yaw: double
  AngularVelocity: double[1 3]

BusLaneBoundaries = Simulink.Bus()
  NumLaneBoundaries: double
  Time: double
  LaneBoundaries: Bus: BusLaneBoundariesLaneBoundaries[7 1]

BusLaneBoundariesLaneBoundaries = Simulink.Bus()
  Coordinates: double[401 3]
  Curvature: double[401 1]
  CurvatureDerivative: double[401 1]
  HeadingAngle: double
  LateralOffset: double
  BoundaryType: uint8
  Strength: double
  Width: double
  Length: double
  Space: double

BusVehicleToWorldActors = Simulink.Bus()
  NumActors: double
  Time: double
  Actors: Bus: BusActorsActors[2 1]

VehPgons = Simulink.Bus()
  NumVeh: double
  VehPgon: Bus: Polygon[2 1]

Polygon = Simulink.Bus()
  X: double[4 1]
  Y: double[4 1]

Bus = Simulink.Bus()

BusObjectDetections = Simulink.Bus()
  NumDetections: double
  IsValidTime: boolean
  Detections: Bus: BusObjectDetectionsDetections[50 1]

BusObjectDetectionsDetections = Simulink.Bus()
  Time: double
  Measurement: double[6 1]
  MeasurementNoise: double[6 6]
  SensorIndex: double
  ObjectClassID: double
  ObjectAttributes: Bus: BusObjectDetectionsDetectionsObjectAttributes
  MeasurementParameters: Bus: BusObjectDetectionsDetectionsMeasurementParameters

BusObjectDetectionsDetectionsObjectAttributes = Simulink.Bus()
  TargetIndex: double

BusObjectDetectionsDetectionsMeasurementParameters = Simulink.Bus()
  Frame: Enum: drivingCoordinateFrameType
  OriginPosition: double[3 1]
  Orientation: double[3 3]
  HasVelocity: boolean

BusLaneDetections = Simulink.Bus()
  Time: double
  IsValidTime: boolean
  SensorIndex: double
  NumLaneBoundaries: double
  LaneBoundaries: Bus: BusLaneDetectionsLaneBoundaries[30 1]

BusLaneDetectionsLaneBoundaries = Simulink.Bus()
  Curvature: double
  CurvatureDerivative: double
  CurveLength: double
  HeadingAngle: double
  LateralOffset: double
  BoundaryType: uint8
  Strength: double
  Width: double

BusDetectionConcatenation1 = Simulink.Bus()
  NumDetections: double
  IsValidTime: boolean
  Detections: Bus: BusDetectionConcatenation1Detections[70 1]

BusDetectionConcatenation1Detections = Simulink.Bus()
  Time: double
  Measurement: double[3 1]
  MeasurementNoise: double[3 3]
  SensorIndex: double
  ObjectClassID: double
  MeasurementParameters: Bus: BusDetectionConcatenation1DetectionsMeasurementParameters
  ObjectAttributes: Bus: BusRadarDetectionsObjectAttributes

BusDetectionConcatenation1DetectionsMeasurementParameters = Simulink.Bus()
  Frame: Enum: drivingCoordinateFrameType
  OriginPosition: double[3 1]
  Orientation: double[3 3]
  HasVelocity: boolean
  HasElevation: boolean

BusMultiObjectTracker = Simulink.Bus()
  NumTracks: double
  Tracks: Bus: BusMultiObjectTrackerTracks[100 1]

BusMultiObjectTrackerTracks = Simulink.Bus()
  TrackID: uint32
  BranchID: uint32
  SourceIndex: uint32
  UpdateTime: double
  Age: uint32
  State: double[6 1]
  StateCovariance: double[6 6]
  ObjectClassID: double
  TrackLogic: Enum: trackLogicType
  TrackLogicState: boolean[1 5]
  IsConfirmed: boolean
  IsCoasted: boolean
  IsSelfReported: boolean
  ObjectAttributes: Bus: BusRadarDetectionsObjectAttributes[2 1]